# Dynamo graph Home.dyn (Dynamo 0.7.4.3245)

code_block = CodeBlock { 0..10..#50; }
code_block_2 = CodeBlock { 50; }
randomList = Math.RandomList(code_block_2)
integer_slider = IntegerSlider(4, range=0..10)
code_block_3 = CodeBlock { 1; }
scatterPlotOptions = Grapher.scatterPlot.scatterPlotOptions(arg6=integer_slider, arg8=code_block_3)
create = Grapher.scatterPlot.create(code_block, randomList, scatterPlotOptions)
watch_image = WatchImageCore(create)
code_block_4 = CodeBlock { 2; }
