# Dynamo graph NurbsExportAsSVG.dyn (Dynamo 0.8.3.2752)

byCoordinates = Point.ByCoordinates()
code_block = CodeBlock { 50; }
byCoordinates_2 = Point.ByCoordinates(y=code_block)
code_block_2 = CodeBlock { 100; }
byCoordinates_3 = Point.ByCoordinates(x=code_block_2, y=code_block)
byCoordinates_4 = Point.ByCoordinates(x=code_block_2, y=code_block_2)
code_block_3 = CodeBlock(p1=byCoordinates, p2=byCoordinates_2, p3=byCoordinates_3, p4=byCoordinates_4) { {p1, p2, p3, p4}; }
code_block_4 = CodeBlock { 3; }
byPoints = NurbsCurve.ByPoints(code_block_3, code_block_4)
code_block_5 = CodeBlock { "C:\Users\pratapa.ADS\Documents"; }
code_block_6 = CodeBlock { "test"; }
export = Illustrator.SVG.export(byPoints, code_block_5, code_block_6)
